# Grasshopper definition w21_robot_control.gh (Grasshopper 1.0.7)

# ----
# ROS client
panel = Panel("192.168.1.21")
connect = BooleanToggle(True)
ros = PythonScript(ip=panel, connect=connect)  # -> out, ros_client
# ---------- ros: Python ----------
import sys
import time
import logging
import scriptcontext as sc

from compas_fab.backends import RosClient

from System import TimeSpan
from System.Threading import ManualResetEventSlim

LOGGER = logging.getLogger('roslibpy')

if connect:
    #Reset Connection
    key = 'rosclient_%s' % str(ghenv.Component.InstanceGuid)
    previous_client = sc.sticky.get(key, None)
    if previous_client:
        previous_client.terminate()
    #Create new RosClient
    ros_client = RosClient(ip, 9090)
    sc.sticky[key] = ros_client
    
    #Create new connection
    LOGGER.debug('Connecting...')
    waitLock = ManualResetEventSlim(False)
    ros_client.on_ready(lambda: waitLock.Set())
    ros_client.connect()
    
    if not waitLock.Wait(TimeSpan.FromSeconds(5)):
        raise Exception('Unable to connect to ROS')
    
    LOGGER.info('ROS connection opened')

else:    
    key = 'rosclient_%s' % str(ghenv.Component.InstanceGuid)
    ros_client = sc.sticky.get(key, None)
    if ros_client:
        ros_client.terminate()
        LOGGER.debug('Terminated')

if ros_client:
    print ros_client.is_connected
# ---------- end ros ----------
is_connected = Panel(ros.out)

# ----
# Forward Kinematic
main_planning_group = Text("manipulator")

simulation_slider = Slider(0, range=0..1)

# ----
# Load Robot from ROS
units = ValueList({"m": 1, "cm": 100, "mm": 1000}, selected="m")

# ----
# Load Tool to ROS
panel_2 = Panel("0.096,0,0")
pl = ConstructPlane(Origin=panel_2, XAxis="1,0,0", YAxis="0,1,0")
mesh = Mesh(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)
pln = Plane(pl)
scale_nu = ScaleNU(Geometry=mesh, Plane=PlaneXY(0, 0, 0), ScaleX=1, ScaleY=1, ScaleZ=Slider(0.9, range=0..1))  # -> Geometry, Transform

# ----
# Load Collision Scene to ROS
mesh_2 = Mesh(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)

# ----
# Robot Setup
load = Button()

python = PythonScript(client=ros.ros_client, scale_factor=units, load=load)  # -> out, robot; inputs load: Boolean
# ---------- python: Python ----------
import os
from scriptcontext import sticky as st
import compas
from compas.robots import RobotModel
from compas_fab.backends import RosClient
from compas_fab.backends import RosFileServerLoader
from compas_fab.robots import Robot
from compas_fab.robots import RobotSemantics
from compas_fab.ghpython import RobotArtist

# Set high precision to import meshes defined in meters
compas.PRECISION = '24f'

# store robot in component
guid = str(ghenv.Component.InstanceGuid)
robot_key = "robot_" + guid


if robot_key not in st:
    st[robot_key] = None

if client and client.is_connected and load:
    # Load URDF from ROS
    loader = RosFileServerLoader(client)
    urdf = loader.load_urdf()
    srdf = loader.load_srdf()

    # Create robot model from URDF and load geometry
    model = RobotModel.from_urdf_string(urdf)
    model.load_geometry(loader)
    
    semantics = RobotSemantics.from_srdf_string(srdf, model)
    
    robot = Robot(model, semantics=semantics)
    robot.artist = RobotArtist(robot.model)
    robot.scale(scale_factor)
    st[robot_key] = robot

robot = st[robot_key]
if robot:
    robot.client = client
    robot.info()
# ---------- end python ----------

scene = PythonScript(robot=python.robot, mesh=mesh_2)
# ---------- scene: Python ----------
from scriptcontext import sticky as st
from compas_rhino.geometry import RhinoMesh
from compas_fab.robots import PlanningScene
from compas_fab.robots import CollisionMesh


# store scene in component
guid = str(ghenv.Component.InstanceGuid)
scene_key = "scene_" + guid
id="CollisionMesh"
scale=False

if robot and mesh:
    if (scene_key not in st): #if no scene have been setup before
        #Create Sticky Scene Key
        st[scene_key] = None
        #Create Scene
        st[scene_key] = PlanningScene(robot)
        scene = st[scene_key]
    else : #if a scene have been setup before
        scene.remove_collision_mesh(id)
    
    compas_mesh = RhinoMesh.from_geometry(mesh).to_compas()
    cm = CollisionMesh(compas_mesh, id)
    #add 
    scene.add_collision_mesh(cm, scale)
# ---------- end scene ----------

robot_info = Panel(python.out)
robot = Data(python.robot)

py = PythonScript(robot=python.robot, mesh=scale_nu.Geometry, pln=pln)  # inputs mesh: Mesh
# ---------- py: Python ----------
import os
import math
import rhinoscriptsyntax as rs
from compas.geometry import Frame
from compas.geometry import Rotation
from compas.datastructures import Mesh
from compas_ghpython.artists import MeshArtist
from compas_fab.robots import Tool
from compas_fab.robots import CollisionMesh
from compas_fab.robots import AttachedCollisionMesh
from compas_fab.robots import PlanningScene
from compas_rhino.geometry import RhinoMesh
from compas_rhino.geometry import RhinoPlane
import Rhino.Geometry as rg

scale = False
scene =  PlanningScene(robot)
if robot and mesh and pln :
    mesh.Rotate(math.pi/2,rg.Vector3d(0,1,0),rg.Point3d(0,0,0))
    mesh.Translate(0.006,0,0)
    ee_mesh = RhinoMesh.from_geometry(mesh).to_compas()
    ee_frame = RhinoPlane.from_geometry(pln).to_compas()
    #original ee_frame = Frame([0.10, 0, 0], [0, 0, 1], [0, -1, 0])
    #ee_frame = Frame([0.096, 0, 0], [1, 0, 0], [0, 1, 0])
    
    robot.attach_tool(Tool(ee_mesh, ee_frame))
    """
    link_names = robot.get_link_names()
    idxs = [3,4,5,6,7]
    touch_links = [link_names[i] for i in idxs]
    link_name = link_names[7] #ee_link
    
    cm = CollisionMesh(ee_mesh, "tip")
    acm = AttachedCollisionMesh(cm, link_name, touch_links)
    
    scene.add_attached_collision_mesh(acm, scale)
    """
else :
    if robot :
        robot.detach_tool()
        #scene.remove_collision_mesh("tip")

#if show:
#    artist = MeshArtist(ee_mesh)
#    M = artist.draw()
# ---------- end py ----------

# ---- group: forward kinematics
a4 = Slider(-90, range=-360..360)
a1 = Slider(90, range=-360..360)
a2 = Slider(-90, range=-360..360)
a3 = Slider(90, range=-360..360)
a5 = Slider(-90, range=-360..360)
a6 = Slider(90, range=-360..360)
jp = GhPythonScript()  # -> joint_positions
# ---------- jp: Python ----------
import math

joint_positions = [90,-90,90,-90,-90,90]
joint_positions = [math.radians(a) for a in joint_positions]
#joint_positions = [-3.136, -0.328, -1.218, 3.129, 0.852, 0.008]
#joint_positions = [0] * 6

print joint_positions
# ---------- end jp ----------
forward_kinematics = PythonScript(
    robot=robot,
    group=main_planning_group,
    set_joint_positions=Button(),
    joint_positions=jp,
    a1=a1,
    a2=a2,
    a3=a3,
    a4=a4,
    a5=a5,
    a6=a6)  # -> full_configuration, joint_trajectory; inputs joint_positions: list
# ---------- forward_kinematics: Python ----------
import math
import Grasshopper
from compas.robots import Joint
from compas_fab.robots import JointTrajectory, JointTrajectoryPoint,Duration
from compas_fab.robots import Configuration

if set_joint_positions:

    j = 0
    for i in range(ghenv.Component.Params.Input.Count):
        nslider = ghenv.Component.Params.Input[i].Sources[0]
        if nslider.GetType() == Grasshopper.Kernel.Special.GH_NumberSlider:
            nslider.TrySetSliderValue(math.degrees(joint_positions[j]))
            j += 1

if robot:
    joint_positions = [a1, a2, a3, a4, a5, a6]
    
    joint_types = robot.get_configurable_joint_types()
    for i, joint_type in enumerate(joint_types):
        if joint_type == Joint.REVOLUTE:
            joint_positions[i] = math.radians(joint_positions[i])
    print(joint_positions)
    print(joint_types)
    full_configuration = Configuration(joint_positions, joint_types)
    
    joint_positions = [a1, a2, a3, a4, a5, a6]
    joint_positions = [math.radians(a) for a in joint_positions]
    joint_names = robot.get_configurable_joint_names()
    types = robot.get_configurable_joint_types(group)
    
    trajectory_point = JointTrajectoryPoint(joint_positions,types,time_from_start = Duration(1,0))
    
    
    trajectory_points = [trajectory_point]
   
    joint_trajectory = JointTrajectory(trajectory_points,joint_names)
# ---------- end forward_kinematics ----------

forward = PythonScript(robot=robot, group=main_planning_group, full_configuration=forward_kinematics.full_configuration)  # -> out, frame_WCF
# ---------- forward: Python ----------
"""Calculate the robot's forward kinematic.
    Inputs:
        robot: :class:`compas_fab.robots.Robot`
            The robot.
        group: str, optional
            The planning group used for calculation. Defaults to the robot's
            main planning group.
        full_configuration : :class:`compas_fab.robots.Configuration`
            The full configuration to calculate the forward kinematic for. If no
            full configuration is passed, the zero-joint state for the other
            configurable joints is assumed.
    Output:
        :class:`Frame`
            The frame in the world coordinate frame (WCF).
"""
from __future__ import print_function
import logging

import compas_fab
print(compas_fab.__version__)

LOGGER = logging.getLogger('roslibpy')

if robot and robot.client and full_configuration:
    if robot.client.is_connected:
        frame_WCF = robot.forward_kinematics(full_configuration, group, options={'backend':'model'})
        #frame_WCF = robot.forward_kinematics(full_configuration, group, backend='model')
        print(frame_WCF)
    else:
        print("Robot is not connected")
# ---------- end forward ----------
panel_3 = Panel(forward.out)

# ----
# Homing
execute = Button()
check = Button()
cancel = Button()
trajectory = PythonScript(robot=robot, response=forward_kinematics.joint_trajectory, execute=execute, check=check, cancel=cancel)  # -> out, status
# ---------- trajectory: Python ----------
import time
import datetime

import roslibpy

import scriptcontext as sc

#client = roslibpy.Ros(host='192.168.1.21', port=9090)
#client.run()

isCompleted = 0
key = 'trajectory_%s' % str(ghenv.Component.InstanceGuid)
sent_trajectory = sc.sticky.get(key, None)
#print(len(response))

#joint_trajectory = response.trajectory.joint_trajectory if response else None
joint_trajectory = response if response else None
#points = response.points if response else []



if robot and robot.client.is_connected:
    if execute:
        #isCompleted = False
        sc.sticky[key] = dict(started_at=time.time(), trajectory=joint_trajectory, state='EXECUTING')
        print ('executing')
        def completion(result):
            if key in sc.sticky:
                if sc.sticky[key]['state'] == 'EXECUTING':
                    sc.sticky[key]['state'] = 'SUCCESSFUL'
                    #client = roslibpy.Ros(host='192.168.1.21', port=9090)
                    #client.run()
                    isCompleted = 99999999
                    #service = roslibpy.Service(client, '/ur_hardware_interface/set_io', 'ur_msgs/SetIO')
                    #request = roslibpy.ServiceRequest({"fun": 1, "pin": 0 ,"state": 0})
                    #result = service.call(request)
                sc.sticky[key]['completed_at'] = time.time()
                del sc.sticky[key]['cancellable']

        def failure(e):
            if key in sc.sticky:
                sc.sticky[key]['state'] = 'ERROR'
                sc.sticky[key]['completed_at'] = time.time()
                sc.sticky[key]['exception'] = e

        #print('Executing trajectory of %d points' % len(points))
        #cancellable = robot.client.follow_joint_trajectory(joint_trajectory,  callback=completion, errback=failure)
        cancellable = robot.client.follow_joint_trajectory(joint_trajectory,action_name='/scaled_pos_joint_traj_controller/follow_joint_trajectory', callback=completion, errback=failure)
        sc.sticky[key]['cancellable'] = cancellable
    """
    while sc.sticky[key]['state'] == 'EXECUTING':
        #isCompleted = False
        time.sleep(0.5)
    """
    #isCompleted = True
    
    if cancel and 'cancellable' in sc.sticky[key]:
        sc.sticky[key]['state'] = 'CANCELLED'
        sc.sticky[key]['cancellable'].cancel()
        
else:
    status = 'NOT CONNECTED'
"""
try:
    started_at = sc.sticky[key].get('started_at', 'n/a')
    completed_at = sc.sticky[key].get('completed_at', 'n/a')
    exception = sc.sticky[key].get('exception', '')
    execution_state = sc.sticky[key].get('state', '')
    
    if started_at != 'n/a':
        started_at = datetime.datetime.fromtimestamp(started_at).strftime('%H:%M:%S')
    if completed_at != 'n/a':
        completed_at = datetime.datetime.fromtimestamp(completed_at).strftime('%H:%M:%S')
    if exception:
        exception = 'Found an exception during execution: ' + str(exception)
    
    if not joint_trajectory:
        status = 'No trajectory available'
    else:
        status = "execution state: {}
    started at: {}
    completed at: {}
    trajectory of {} points\n{}".format(execution_state,
                                          started_at,
                                          completed_at,
                                          len(points),
                                          exception)
except KeyError:
    pass
"""
# ---------- end trajectory ----------
status = Panel(trajectory.status)
panel_4 = Panel(trajectory.out)

# ----
# /joint_states topic
unsubscribe = Button()
refresh_hz = Slider(2, range=0..30)
subscribe = Button()
start_timer_update = Button()
stop_timer_update = Button()
joint_states = PythonScript(robot=robot, sub=subscribe, unsub=unsubscribe)
# ---------- joint_states: Python ----------
import roslibpy
import scriptcontext as sc

key = 'topic_%s' % str(ghenv.Component.InstanceGuid)
previous_topic = sc.sticky.get(key, None)

# Interval in ms between messages
THROTTLE_RATE = 50

if sub:
    if robot.client.is_connected:
        if previous_topic:
            previous_topic.unsubscribe()

        def received_joint_states(message):
            sc.sticky['joint_states'] = message
    
        topic = roslibpy.Topic(robot.client, '/joint_states', 'sensor_msgs/JointState', throttle_rate=THROTTLE_RATE)
        topic.subscribe(received_joint_states)
    
        sc.sticky[key] = topic
        print('Subscribed')
    else:
        print('ROS client not connected')

if unsub:
    if 'joint_states' in sc.sticky:
        del sc.sticky['joint_states']
    if previous_topic:
        previous_topic.unsubscribe()
# ---------- end joint_states ----------
current = PythonScript(
    robot=robot,
    rate=refresh_hz,
    subscribe=subscribe,
    unsubscribe=unsubscribe,
    start_update=start_timer_update,
    stop_update=stop_timer_update)  # -> out, configuration; inputs subscribe: Boolean, unsubscribe: Boolean, start_update: Boolean, stop_update: Boolean
# ---------- current: Python ----------
import scriptcontext as sc
from compas_fab.robots import Configuration
from compas_ghpython import update_component
from datetime import datetime


guid = str(ghenv.Component.InstanceGuid)
timer_running_key = "timer_running_" + guid

if stop_update or timer_running_key not in sc.sticky or unsubscribe:
    sc.sticky[timer_running_key] = False

if start_update or subscribe:
    sc.sticky[timer_running_key] = True



values = []
types = []

now = datetime.now()
timestamp = datetime.time(now)


print('receiving joint states at: ' + str(timestamp))


if 'joint_states' in sc.sticky:
    
    joint_states = sc.sticky['joint_states']
    joint_states = dict(zip(joint_states['name'], joint_states['position']))

    for joint in robot.get_configurable_joints():
        values.append(joint_states[joint.name])
        types.append(joint.type)
    
    configuration = Configuration(values, types)
    print(configuration)

else:
    print "not joint states in sc sticky"
    #configuration = robot.get_configuration()
    #configuration.values = [0,0,0,0,0,0]
    
    

data_coming_in = robot.client.is_connected and 'joint_states' in sc.sticky

slow_interval = 2000
if rate != 0:
    refresh_interval = (1. / rate) * 1000
else:
    refresh_interval = slow_interval
interval = refresh_interval if data_coming_in else slow_interval

if sc.sticky[timer_running_key]==True:
    print sc.sticky[timer_running_key]
    update_component(ghenv, interval)

#update_component(ghenv, interval)
print('Interval: %dms' % interval)
# ---------- end current ----------
panel_5 = Panel(current.out)

# ---- group: Resizing and Repositioning the contours
subscribed = BooleanToggle(True)
timer = Timer(TimerInterval=1000, Target=python_2)
python_2 = GhPythonScript(ros_client=ros.ros_client, topic="/image_size", sub=subscribed)  # -> out, data
# ---------- python_2: Python ----------
import roslibpy
import scriptcontext as sc

key = 'topic_%s' % str(ghenv.Component.InstanceGuid)
previous_topic = sc.sticky.get(key, None)

# Interval in ms between messages
THROTTLE_RATE = 50

if ros_client.is_connected:
    if topic: 
        if sub:
            if previous_topic:
                if topic in sc.sticky:
                    data = sc.sticky[topic]['data']
                    print('Receiving')
                else:
                    print('Waiting')
            else : 
                def received_size(message):
                    sc.sticky[topic] = message
            
                topic = roslibpy.Topic(ros_client, topic, 'std_msgs/String' , throttle_rate=THROTTLE_RATE)
                topic.subscribe(received_size)
            
                sc.sticky[key] = topic
                print('Subscribed')
                if topic in sc.sticky:
                    data = sc.sticky[topic]['data']
        else :
            if topic in sc.sticky:
                del sc.sticky[topic]
            if previous_topic:
                previous_topic.unsubscribe()
                del sc.sticky[key]
            print('Unsubscribed')
    else:
        print('Missing topic')
else:
    print('ROS client not connected')
# ---------- end python_2 ----------
status_2 = Panel(python_2.out)
panel_6 = Panel(python_2.data)
split = TextSplit(Text=panel_6, Separators=",")
item = ListItem(List=split, Index=0, Wrap=True)  # -> Item, Item1
X = UnitX(Factor="-1")
Y = UnitY(Factor="-1")
pl_2 = ConstructPlane(Origin="1.214,0.403,-0.025", XAxis=X, YAxis=Y)
rectangle = Rectangle(Plane=pl_2, XSize=".593", YSize=".790", Radius=0)  # -> Rectangle, Length
rec = Rectangle(rectangle.Rectangle)

# ---- group: Reading Contours
subscribed_2 = BooleanToggle(True)
timer_2 = Timer(TimerInterval=1000, Target=python_3)
python_3 = GhPythonScript(ros_client=ros.ros_client, topic="/contours_rs", sub=subscribed_2)  # -> out, data; same code as python_2
status_3 = Panel(python_3.out)

# ----
subscribed_3 = BooleanToggle(True)
timer_3 = Timer(TimerInterval=1000, Target=python_4)  # disabled
python_4 = GhPythonScript(ros_client=ros.ros_client, topic="/colors_rs", sub=subscribed_3)  # -> out, data; same code as python_2
split_2 = TextSplit(Text=python_4.data, Separators="+")
status_4 = Panel(python_4.out)
split_3 = TextSplit(Text=split_2, Separators=",")
toggle = BooleanToggle(True)
cull_i = CullIndex(List=split_3, Indices="-1", Wrap=True)
trim = TextTrim(Text=cull_i, Start=toggle, End=toggle)
int = Integer(reverse(trim))
item_2 = ListItem(List=int, Index=0, Wrap=True)  # -> Item, Item1, Item2
rgb = ColourRGB(Alpha=255, Red=item_2.Item, Green=item_2.Item1, Blue=item_2.Item2)

# ----
# Read contours
panel_7 = Panel(python_3.data)
xy = XYPlane(Origin=Point(0, 0, 0))
panel_8 = Panel(item.Item)
panel_9 = Panel(item.Item1)

# ---- group: Resizing and Repositioning the contours (continued)
rectangle_2 = Rectangle(Plane=xy, XSize=panel_8, YSize=panel_9, Radius=0)  # -> Rectangle, Length
rec_2 = Rectangle(rectangle_2.Rectangle)

# ---- group: Reading Contours (continued)
split_4 = TextSplit(Text=panel_7, Separators="+")
python_5 = GhPythonScript(msg=split_4)  # -> out
# ---------- python_5: Python ----------
msg = msg.split(',')
for i in msg:
    if len(i) > 2:
        print i
# ---------- end python_5 ----------

# ----
trim_2 = TextTrim(Text=python_5, Start=True, End=True)
rep = ReplaceText(Text=trim_2, Find="_", RecursiveReplace=False)

# ---- group: Reading Contours (continued)
partition = PartitionList(List=rep, Size="2")
item_3 = ListItem(List=partition, Index=0, Wrap=True)  # -> Item, Item1
pt = ConstructPoint(XCoordinate=item_3.Item1, YCoordinate=item_3.Item, ZCoordinate=0)
trim_3 = TrimTree(Tree=pt, Depth=1)  # -> simplify(Tree)
pline = PolyLine(Vertices=trim_3, Closed=invert(False))
crv = Curve(pline)

# ----
recmap = RectangleMapping(Geometry=crv, Source=rec_2, Target=rec)  # -> Geometry, Transform

boundary = BoundarySurfaces(Edges=recmap.Geometry)
preview = CustomPreview(Geometry=boundary, Material=rgb)

dam = DataDam(DataA=recmap.Geometry, BufferDelay=10000000, BufferMode=0)

# ---- group: Design
crv_2 = Curve(dam)
pt_2 = Point(Point(0.6155944337, 0.1660195232, -0.02156147166))
pt_3 = Point(Point(0.3165007268, 0.1629649722, -0.02308311853))
area = Area(Geometry=crv_2)  # -> Area, simplify(Centroid)
pt_4 = Point(Point(0.321360051, -0.1351933605, -0.02208716448))
pt_5 = Point(Point(0.6206179254, -0.1308157404, -0.02081252997))
avr = Average(Input=[pt_2, pt_5, pt_4, pt_3])
move = Move(Geometry=area.Centroid, Motion="{0,0,0.006}")  # -> Geometry, Transform
srf4pt = _4PointSurface(CornerA=pt_2, CornerB=pt_3, CornerC=pt_4, CornerD=pt_5)
move_2 = Move(Geometry=avr, Motion="{0,0,0.020}")  # -> Geometry, Transform
lng = ListLength(List=flatten(area.Centroid))
md_slider = MDSlider(
    SliderMode=0,
    slider_value=Point(0.4982910156, 0.5008134842, 0.5),
    x_domain=Domain(0, 1),
    y_domain=Domain(0, 1),
    z_domain=Domain(0, 1))
mirror = Mirror(Geometry=move.Geometry, Plane=PlaneYZ(0, 0, 0))  # -> Geometry, Transform
project = Project(Geometry=srf4pt, Plane=move_2.Geometry)  # -> Geometry, Transform
random = Random(Range="0 TO 3.14", Number=lng, Seed=2)  # -> simplify(graft(Random))
xy_2 = XYPlane(Origin=mirror.Geometry)
evalsrf = EvaluateSurface(Surface=reparameterize(project.Geometry), Point=md_slider)  # -> Point, Normal, UDirection, VDirection, Frame
rotate = Rotate(Geometry=xy_2, Angle=random, Plane=xy_2)  # -> Geometry, Transform
pln_2 = Plane(area.Centroid)
pln_3 = Plane(rotate.Geometry)
scale = Scale(Geometry=project.Geometry, Center=evalsrf.Frame, Factor="0.7")  # -> Geometry, Transform
popgeo = PopulateGeometry(Geometry=scale.Geometry, Count="2", Seed=Slider(2, range=0..10))
orient = Orient(Geometry=rotate.Geometry, Source=rotate.Geometry, Target=graft(popgeo))  # -> Geometry, Transform

# ---- group: Path planning / Pick plane
pln_4 = Plane(simplify(pln_2))

# ---- group: Path planning / Place plane
pln_5 = Plane(simplify(orient.Geometry))

# ---- group: Path planning
# Target Commands
number_slider = Slider(0.1, range=0..0.3)
pt_6 = Point(Point(0.6260896604, -0.00316378087, 0.3021788167))
xy_3 = XYPlane(Origin=pt_6)
lng_2 = ListLength(List=pln_4)
repeat = RepeatData(Data=xy_3, Length=lng_2)
Z = UnitZ(Factor=number_slider)
move_3 = Move(Geometry=pln_4, Motion=Z)  # -> Geometry, Transform
trim_4 = TrimTree(Tree=repeat, Depth=1)
panel_10 = Panel("""0
0
1
1
1
1
0
0""")
bool = Boolean(panel_10)
pt_7 = Point(Point(0.2731942371, 0.4485265083, 0.532949573))
xy_4 = XYPlane(Origin=pt_7)
deplane = DeconstructPlane(Plane=xy_4)  # -> Origin, XAxis, YAxis, ZAxis
rot3d = Rotate3D(Geometry=xy_4, Angle=1.570796327, Center=deplane.Origin, Axis=deplane.YAxis)  # -> Geometry, Transform

# ----
move_4 = Move(Geometry=pln_5, Motion=Z)  # -> Geometry, Transform

# ---- group: Path planning (continued)
merge = Merge(
    Data1=trim_4,
    Data2=move_3.Geometry,
    Data3=pln_4,
    Data4=move_3.Geometry,
    Data5=trim_4,
    Data6=move_4.Geometry,
    Data7=pln_5,
    Data8=move_4.Geometry)
deplane_2 = DeconstructPlane(Plane=merge)  # -> Origin, XAxis, YAxis, ZAxis
lng_3 = ListLength(List=merge)
repeat_2 = RepeatData(Data=bool, Length=lng_3)
rot3d_2 = Rotate3D(Geometry=merge, Angle=1.570796327, Center=deplane_2.Origin, Axis=deplane_2.YAxis)  # -> Geometry, Transform
merge_2 = Merge(Data1=Toggle(False), Data2=repeat_2)
merge_3 = Merge(Data1=rot3d.Geometry, Data2=rot3d_2.Geometry)

# ----
# Request Path Planning
pln_6 = Plane(flatten(merge_3))
bool_2 = Boolean(flatten(merge_2))
robot_2 = Data(robot)
plan_motion = PythonScript(robot=robot_2, planes=pln_6, tool_data=bool_2, compute=Toggle(False))  # -> out, allTrajectories, full_configurations; inputs planes: list, tool_data: list of Int32
# ---------- plan_motion: Python ----------
from __future__ import print_function
import logging
import scriptcontext as sc
import math
from compas.geometry import Frame
from compas_fab.robots import Configuration
from compas_fab.backends import BackendError

allConfigurations = []
allTrajectories = []

if compute:
    print(len(planes))
    for i in range(0,len(planes)-1):
        data = []
        traj_temp = []
        tool_states = [tool_data[i],tool_data[i+1]]
        planes_plan = planes[i:i+2]
        print("planes_plan: ",i,len(planes_plan))
        
        frames = [Frame(plane.Origin, plane.XAxis, plane.YAxis) for plane in planes_plan]
        #frames = [Frame(planes[i].Origin, planes[i].XAxis, planes[i].YAxis)]
        #if i==0:
        #    frames.insert(0,ee_frame_WCF)
        
        frames = [robot.from_tcf_to_t0cf([frame])[0] for frame in frames]
        
        if i==0:
            i_configuration = Configuration.from_revolute_values((1.571, -1.571, 1.571, -1.571, -1.571, 1.571))
            #ee_frame_WCF = robot.forward_kinematics(i_configuration, group, options={'backend':'model'})
            home_configuration = robot.inverse_kinematics(frames[0], i_configuration)
        else:
            #Configuration(picking_trajectory.points[-1].values, picking_trajectory.points[-1].types)
            i_configuration = Configuration(trajectory.points[-1].values, trajectory.points[-1].types)
            home_configuration = i_configuration
        options = {
            'max_step': 0.01,
            'avoid_collisions': True
        }
    
        trajectory = robot.plan_cartesian_motion(frames,
                                                 home_configuration,
                                                 options=options)
        configuration = trajectory.points
        allConfigurations += trajectory.points
        del trajectory.points[0]
        #allTrajectories = trajectory
        #traj_temp.append(trajectory)
        data.append(tool_states)
        data.append(trajectory)
        allTrajectories.append(data)
        print("allTrajectories: ",len(allTrajectories))
        print("Computed cartesian path with %d configurations, " % len(trajectory.points))
        print("following %d%% of requested trajectory." % (trajectory.fraction * 100))
        print("Executing this path at full speed would take approx. %.3f seconds." % trajectory.time_from_start)
        
        full_configurations = [robot.merge_group_with_full_configuration(c, trajectory.start_configuration, 'manipulator') for c in allConfigurations]
# ---------- end plan_motion ----------
panel_11 = Panel(plan_motion.out)

panel_12 = Panel(pln_6)
dam_2 = DataDam(DataA=plan_motion.full_configurations, BufferDelay=10000000, BufferMode=0)
data = Data(dam_2)

# ----
# Execute path planning
cancel_2 = Button()
check_2 = Button()
trajectory_2 = PythonScript(
    robot=robot,
    client=ros.ros_client,
    response=plan_motion.allTrajectories,
    execute=Toggle(False),
    check=check_2,
    cancel=cancel_2)  # -> out, status; inputs response: list
# ---------- trajectory_2: Python ----------
import time
import datetime

import roslibpy

import scriptcontext as sc

#client = roslibpy.Ros(host='192.168.1.21', port=9090)
#client.run()

key = 'trajectory_%s' % str(ghenv.Component.InstanceGuid)
sent_trajectory = sc.sticky.get(key, None)

numTrajectories = len(response)
print(numTrajectories)
actualTrajectory = 0
"""
def nextExecute():
    global numTrajectories
    global actualTrajectory
    print("next")
    actualTrajectory+=1
    if(actualTrajectory < numTrajectories):
        executeAll(actualTrajectory)

def callTool():
    global actualTrajectory
    print("callTool")
    tool_state = response[actualTrajectory][0][1]
    service = roslibpy.Service(client, '/ur_hardware_interface/set_io', 'ur_msgs/SetIO')
    request = roslibpy.ServiceRequest({"fun": 1, "pin": 0 ,"state": tool_state})
    result = service.call(request)
"""
def completion(result):
    
    print("---> completion")
    if key in sc.sticky:
        if sc.sticky[key]['state'] == 'EXECUTING':
            sc.sticky[key]['state'] = 'SUCCESSFUL'
            sc.sticky[key]['completed_at'] = time.time()
            del sc.sticky[key]['cancellable']
    
def failure(exception):
    print("---> failure: ",exception)
    """
    global numTrajectories
    global actualTrajectory
    actualTrajectory+=1
    if(actualTrajectory<numTrajectories):
        executeAll(actualTrajectory)
    """
    if key in sc.sticky:
        sc.sticky[key]['state'] = 'ERROR'
        sc.sticky[key]['completed_at'] = time.time()
        sc.sticky[key]['exception'] = e

def feedback():
    print("feedback: ")
lastToolState = 0
def executeAll(i):
    global lastToolState
    global numTrajectories
    global actualTrajectory
    actualTrajectory = i
    joint_trajectory = response[actualTrajectory][1] if response else None
    points = response[actualTrajectory][1].points if response else []
    sc.sticky[key] = dict(started_at=time.time(), trajectory=joint_trajectory, state='EXECUTING')
    
    print('Executing trajectory of %d points' % len(points))
    #cancellable = robot.client.follow_joint_trajectory(joint_trajectory, completion, failure)
    cancellable = robot.client.follow_joint_trajectory(joint_trajectory,'/scaled_pos_joint_traj_controller/follow_joint_trajectory', completion, failure)
    sc.sticky[key]['cancellable'] = cancellable
    while sc.sticky[key]['state'] == 'EXECUTING':
        print('.....')
        time.sleep(0.25)
    
    tool_state = response[actualTrajectory][0][1]
    service = roslibpy.Service(client, '/ur_hardware_interface/set_io', 'ur_msgs/SetIO')
    request = roslibpy.ServiceRequest({"fun": 1, "pin": 0 ,"state": tool_state})
    result = service.call(request)
    time.sleep(0.25)
    if(actualTrajectory>0 and actualTrajectory<numTrajectories-1):
        actualTrajectory+=1
        tool_state = response[actualTrajectory][0][0]
        service = roslibpy.Service(client, '/ur_hardware_interface/set_io', 'ur_msgs/SetIO')
        request = roslibpy.ServiceRequest({"fun": 1, "pin": 0 ,"state": tool_state})
        result = service.call(request)
        executeAll(actualTrajectory)
    

if robot and robot.client.is_connected:
    if execute:
        #print(response[0].points)
        tool_state = response[0][0][0]
        service = roslibpy.Service(client, '/ur_hardware_interface/set_io', 'ur_msgs/SetIO')
        request = roslibpy.ServiceRequest({"fun": 1, "pin": 0 ,"state": tool_state})
        result = service.call(request)
        executeAll(0)
        time.sleep(7)
        tool_state = response[1][0][0]
        service = roslibpy.Service(client, '/ur_hardware_interface/set_io', 'ur_msgs/SetIO')
        request = roslibpy.ServiceRequest({"fun": 1, "pin": 0 ,"state": tool_state})
        result = service.call(request)
        executeAll(1)
        """
        for i in range(numTrajectories):
            print(i,",",len(response[i].points))
            numPoints = len(response[i].points)
            if numPoints>100:
                duration = len(response[i].points) * 0.08
            else:
                duration = len(response[i].points) * 0.2
            print(i,",",duration)
            executeAll(i)
            time.sleep(duration)
        """
    if cancel and 'cancellable' in sc.sticky[key]:
        sc.sticky[key]['state'] = 'CANCELLED'
        sc.sticky[key]['cancellable'].cancel()
        
else:
    status = 'NOT CONNECTED'
"""
try:
    started_at = sc.sticky[key].get('started_at', 'n/a')
    completed_at = sc.sticky[key].get('completed_at', 'n/a')
    exception = sc.sticky[key].get('exception', '')
    execution_state = sc.sticky[key].get('state', '')
    
    if started_at != 'n/a':
        started_at = datetime.datetime.fromtimestamp(started_at).strftime('%H:%M:%S')
    if completed_at != 'n/a':
        completed_at = datetime.datetime.fromtimestamp(completed_at).strftime('%H:%M:%S')
    if exception:
        exception = 'Found an exception during execution: ' + str(exception)
    
    if not joint_trajectory:
        status = 'No trajectory available'
    else:
        status = "execution state: {}
    started at: {}
    completed at: {}
    trajectory of {} points\n{}".format(execution_state,
                                          started_at,
                                          completed_at,
                                          len(points),
                                          exception)
except KeyError:
    pass
"""
# ---------- end trajectory_2 ----------
panel_13 = Panel(trajectory_2.out)
status_5 = Panel(trajectory_2.status)

cluster = Cluster(configurations=data, B=simulation_slider)

# ----
# Visualization
list = ValueList({"0 MANUAL": 0, "1 LIVE": 1, "2 SIMULATION": 2}, selected="1 LIVE")
# Execution
path = GhPythonScript(robot=robot_2, full_configurations=data)  # -> frames, P; inputs full_configurations: list
# ---------- path: Python ----------
import Rhino.Geometry as rg

frames = []

if robot:
    for c in full_configurations:
        if c:
            frame_WCF = robot.forward_kinematics(c, group, options={'backend':'model'})
            #frame_WCF = robot.forward_kinematics(c, group, backend='model')
            frames.append(frame_WCF)

    P = [rg.Point3d(*list(frame.point)) for frame in frames]
# ---------- end path ----------
filter = StreamFilter(Gate=list, Stream0=forward_kinematics.full_configuration, Stream1=current.configuration, Stream2=cluster)
show_end_effector_frame = BooleanToggle(True)
pline_2 = PolyLine(Vertices=path.P, Closed=False)
show_base_frame = BooleanToggle(True)
show_collision = BooleanToggle(True)
show_frames = BooleanToggle(True)
show_visual = BooleanToggle(True)
preview_2 = CustomPreview(Geometry=[path.P, pline_2], Material=ColourSwatch(SwatchColor=RGB(14, 44, 237)))
visualize = PythonScript(
    robot=robot,
    full_configuration=filter,
    show_visual=show_visual,
    show_collision=show_collision,
    show_frames=show_frames,
    show_base_frame=show_base_frame,
    show_end_effector_frame=show_end_effector_frame)  # -> out, visual, collision, frames, base_frame_WCF, ee_frame_WCF
# ---------- visualize: Python ----------
"""Calculates a cartesian motion path (linear in tool space).
    Inputs:
        robot: The robot
        group: str
            The planning group used for visualisation
        full_configuration: :class:`compas_fab.robots.Configuration`
            The robot's full configuration to display.
        show_visual: bool
           Whether or not to show the robot's visual meshes.
        show_collision: bool
           Whether or not to show the robot's collision meshes.
        show_frames: bool
           Whether or not to show the robot's joint frames.
        show_base_frame: bool
           Whether or not to show the robot's base frame.
        show_end_effector_frame: bool
            Whether or not to show the robot's end-effector frame.
    Output:
        visual: The robot's visual meshes.
        collision: The robot's collision meshes.
        frames: The robot's joint frames.
        base_frame_WCF: The robot's base frame.
        ee_frame_WCF: The robot's end-effector frame.
"""
from __future__ import print_function
import ghpythonlib.components as ghcomp
#from compas_ghpython.geometry import xform_from_transformation

if robot and full_configuration:
    robot.update(full_configuration, visual=show_visual, collision=show_collision)
    print(full_configuration)

    if show_visual:
        visual = robot.draw_visual()
        #visual = ([v for v in visual])
        #T = robot.transformation_RCF_WCF()
        #visual = ghcomp.Transform(visual, xform_from_transformation(T))

    if show_collision:
        collision = robot.draw_collision()

    if show_frames:
        axes = robot.transformed_axes(full_configuration)
        frames = robot.transformed_frames(full_configuration)

    if show_base_frame:
        base_frame_WCF = robot.get_base_frame(group, full_configuration)

    if show_end_effector_frame:
        ee_frame_WCF = robot.get_end_effector_frame(group, full_configuration)
        if robot.attached_tool:
            ee_frame_WCF = robot.from_t0cf_to_tcf([ee_frame_WCF])[0]
        print("End-effector", ee_frame_WCF)
# ---------- end visualize ----------
py_2 = PythonScript(robot=robot)  # -> scale
# ---------- py_2: Python ----------
if robot:
    scale = robot.scale_factor * 0.1
else:
    scale = 1.
# ---------- end py_2 ----------
draw = GhPythonScript(frames=visualize.base_frame_WCF, scale=py_2)  # -> P, V, C, W; inputs frames: list
# ---------- draw: Python ----------
from System.Drawing import Color
from compas_ghpython import draw_frame

red = Color.FromArgb(255, 0, 0)
green = Color.FromArgb(0, 255, 0)
blue = Color.FromArgb(0, 0, 255)

P = []
V = []
C = []

scale = float(scale)

for frame in frames:
    if not frame:
        continue
    plane = draw_frame(frame)
    P += [plane.Origin] * 3
    V.append(plane.XAxis * scale)
    V.append(plane.YAxis * scale)
    V.append(plane.ZAxis * scale)
    C += [red, green, blue]

W = 3
# ---------- end draw ----------
draw_2 = GhPythonScript(frames=[visualize.frames, visualize.ee_frame_WCF, visualize.base_frame_WCF], scale=py_2)  # -> P, V, C, W; inputs frames: list; same code as draw
geo = Geometry(visualize.visual)
geo_2 = Geometry(visualize.collision)
vdisex = VectorDisplayEx(Point=draw.P, Vector=draw.V, Colour=draw.C, Width=draw.W)
vdisex_2 = VectorDisplayEx(Point=draw_2.P, Vector=draw_2.V, Colour=draw_2.C, Width=draw_2.W)
preview_3 = CustomPreview(Geometry=geo, Shader=ColourSwatch(SwatchColor=RGB(105, 105, 105)))
panel_14 = Panel(visualize.out)

item_4 = ListItem(List=flatten(draw_2.P), Index=0, Wrap=True)

panel_15 = Panel(item_4)

# ==== cluster Cluster
configurations = ClusterInput()
configurations_2 = Data(configurations)
lng = ListLength(List=configurations_2)  # -> expr("x-1", Length)
B = ClusterInput()
multiplication = Multiplication(A=lng, B=B)
item = ListItem(List=configurations_2, Index=multiplication, Wrap=True)
i = ClusterOutput(item)
